# Grasshopper definition ChaikinsAlgorithm.gh (Grasshopper 1.0.8)

point = Point([Point(11, 5, 0), Point(11, 52, 0), Point(121, 96, 0), Point(100, 4, 0), Point(152, -28, 0), Point(157, 56, 0)])
polyline = PolyLine(Vertices=point, Closed=False)
c_script = CSharpScript(Points=point, Iterations=Slider(10, range=0..10), Proportions=Slider(0.25, range=0..1), Periodic=Toggle(True))  # -> out, A; inputs Points: list of Point3d, Iterations: Int32, Proportions: Double, Periodic: Boolean
# ---------- c_script: C# ----------
// Grasshopper Script Instance
#region Usings
using System;
using System.Linq;
using System.Collections;
using System.Collections.Generic;
using System.Drawing;

using Rhino;
using Rhino.Geometry;

using Grasshopper;
using Grasshopper.Kernel;
using Grasshopper.Kernel.Data;
using Grasshopper.Kernel.Types;
#endregion

public class Script_Instance : GH_ScriptInstance
{
    #region Notes
    /* 
      Members:
        RhinoDoc RhinoDocument
        GH_Document GrasshopperDocument
        IGH_Component Component
        int Iteration

      Methods (Virtual & overridable):
        Print(string text)
        Print(string format, params object[] args)
        Reflect(object obj)
        Reflect(object obj, string method_name)
    */
    #endregion

    private void RunScript(
		List<Point3d> Points,
		int Iterations,
		double Proportions,
		bool Periodic,
		ref object A)
    {
       List<Point3d> controlPoints = new List<Point3d>(Points);

       if (Periodic)
       {
        controlPoints.Add(controlPoints[0]);
        controlPoints.Add(controlPoints[1]);
       }

       for (int i=0; i<Iterations; i++)
       {
        controlPoints = SmoothPolyline(controlPoints, Proportions);
       } 
       controlPoints.RemoveAt(controlPoints.Count-1);
       
       A = controlPoints;
    }
    private List<Point3d> SmoothPolyline(List<Point3d> pts, double t)
    {
        double t0 = t;
        double t1 = 1-t;
        List<Point3d> newPoints = new List<Point3d>();
        for (int i=1; i<pts.Count; i++)
        {
            Point3d A = pts[i-1];
            Point3d B = pts[i];
            Point3d p0 = PointAlongLine(A, B, t0);
            Point3d p1 = PointAlongLine(A, B, t1);
            newPoints.Add(p0);
            newPoints.Add(p1);
        }
        return newPoints;
    }
    private Point3d PointAlongLine(Point3d a, Point3d b, double t)
    {
        double dx = b.X-a.X;
        double dy = b.Y-a.Y;
        double dz = b.Z-a.Z;

        double nx = t*dx;
        double ny = t*dy;
        double nz = t*dz;

        double cx = a.X+nx;
        double cy = a.Y+ny;
        double cz = a.Z+nz;

        Point3d c = new Point3d(cx, cy, cz);
        return c;
    }
}
# ---------- end c_script ----------
panel = Panel(c_script.A)
polyline_2 = PolyLine(Vertices=c_script.A, Closed=False)
