# Grasshopper definition #Chaikin.gh (Grasshopper 1.0.8)

number_slider = Slider(0.28, range=-50..50)
number_slider_2 = Slider(-18.15, range=-50..50)
number_slider_3 = Slider(0, range=-50..50)
point = Point([Point(-24, 2, 0), Point(217, 93, 0), Point(49, 110, 27), Point(129, 0, 90)])
point_2 = Point([Point(0, 0, 0), Point(31, 0, 0), Point(59, 0, 0), Point(96, -1, 0), Point(140, -1, 0), Point(194, 0, 0)])
number_slider_4 = Slider(6, range=0..10)
number_slider_5 = Slider(0.25, range=0..2)
vector_xyz = VectorXYZ(XComponent=number_slider_2, YComponent=number_slider, ZComponent=number_slider_3)  # -> Vector, Length
c_script = CSharpScript(
    Points=point,
    TangentVector=vector_xyz.Vector,
    ParameterPoint=number_slider_5,
    Periodic=Toggle(False),
    Iterations=number_slider_4)  # -> out, SmoothedPolyline, ControlPolyline; inputs Points: list of Point3d, TangentVector: Vector3d, ParameterPoint: Double, Periodic: Boolean, Iterations: Int32
# ---------- c_script: C# ----------
// Grasshopper Script Instance
#region Usings
using System;
using System.Linq;
using System.Collections;
using System.Collections.Generic;
using System.Drawing;

using Rhino;
using Rhino.Geometry;

using Grasshopper;
using Grasshopper.Kernel;
using Grasshopper.Kernel.Data;
using Grasshopper.Kernel.Types;
#endregion

public class Script_Instance : GH_ScriptInstance
{
    #region Notes
    /* 
      Members:
        RhinoDoc RhinoDocument
        GH_Document GrasshopperDocument
        IGH_Component Component
        int Iteration

      Methods (Virtual & overridable):
        Print(string text)
        Print(string format, params object[] args)
        Reflect(object obj)
        Reflect(object obj, string method_name)
    */
    #endregion

    private void RunScript(
		List<Point3d> Points,
		Vector3d TangentVector,
		double ParameterPoint,
		bool Periodic,
		int Iterations,
		ref object SmoothedPolyline,
		ref object ControlPolyline)
    {
        List<Point3d> smoothedPoints = ChaikinPolylineSmoothingFromInterpolationPoints(Points, TangentVector, Iterations, 
                                        Periodic, ParameterPoint, out List<Point3d> controlPoints);
        SmoothedPolyline = smoothedPoints;
        ControlPolyline = controlPoints;
    }

    private List<Point3d> ChaikinPolylineSmoothingFromInterpolationPoints(List<Point3d> pts, Vector3d vector, int iterations, 
                            bool periodic, double pars, out List<Point3d> controlPts)
    {
        List<Point3d> controlPoints = ControlPointsUsingInterpolatedPoints(pts, vector);
        // Output control point
        controlPts = controlPoints;
        List<Point3d> smoothPoly = ChaikinPolylineSmoothingAlgorithm(controlPoints, iterations, periodic, pars);

        // Remove and replace starting point
        smoothPoly.RemoveAt(0);
        smoothPoly.Insert(0, pts[0]);

        // Replace at end
        smoothPoly.Add(pts[pts.Count-1]);
        return smoothPoly;
    }

    private List<Point3d> ChaikinPolylineSmoothingAlgorithm(List<Point3d> pts, int iterations, bool periodic, double t)
    {
        List<Point3d> controlPoints = new List<Point3d>(pts);
        if(periodic)
        {
            controlPoints.Add(pts[0]);
            controlPoints.Add(pts[1]);
        }
        for(int i=0; i<iterations; i++)
        {
            controlPoints = SmoothPolylineCurve(controlPoints, t);
        }
        controlPoints.RemoveAt(controlPoints.Count-1);
        return controlPoints;
    }
    private List<Point3d> ControlPointsUsingInterpolatedPoints(List<Point3d> pts, Vector3d tangent)
    {
        List<Point3d> controlPoints = new List<Point3d>();
        Point3d startPoint = pts[0];
        startPoint.X += tangent.X;
        startPoint.Y += tangent.Y;
        startPoint.Z += tangent.Z;
        controlPoints.Add(startPoint);
        for(int i=0; i<pts.Count; i++)
        {
            Point3d previousPoint = controlPoints[i];
            Point3d interpolationPoint = pts[i];
            Point3d newPoint = PointAlongCurve(previousPoint, interpolationPoint, 2);
            controlPoints.Add(newPoint);
        }
        return controlPoints;
    }

    private List<Point3d> SmoothPolylineCurve(List<Point3d> pts, double t)
    {
        double t0 = t;
        double t1 = 1-t;
        List<Point3d> newPoints = new List<Point3d>();
        for(int i=1; i<pts.Count; i++)
        {
            Point3d pointA = pts[i-1];
            Point3d pointB = pts[i];
            Point3d p0 = PointAlongCurve(pointA, pointB, t0);
            Point3d p1 = PointAlongCurve(pointA, pointB, t1);
            newPoints.Add(p0);
            newPoints.Add(p1);
        }
        return newPoints;
    }
    private Point3d PointAlongCurve(Point3d a, Point3d b, double t)
    {
        double dx = b.X-a.X;
        double dy = b.Y-a.Y;
        double dz = b.Z-a.Z;

        double nx = t*dx;
        double ny = t*dy;
        double nz = t*dz;

        double cx = a.X+nx;
        double cy = a.Y+ny;
        double cz = a.Z+nz;

        Point3d c = new Point3d(cx, cy, cz);
        return c;
    }
}
# ---------- end c_script ----------
polyline = PolyLine(Vertices=point, Closed=False)
list_item = ListItem(List=point, Index=0, Wrap=True)
polyline_2 = PolyLine(Vertices=c_script.SmoothedPolyline, Closed=False)
polyline_3 = PolyLine(Vertices=c_script.ControlPolyline, Closed=False)
vector_display_ex = VectorDisplayEx(Point=list_item, Vector=vector_xyz.Vector, Colour=RGB(0, 0, 0), Width=2)
length = Length(Curve=polyline_3)
galapagos = Galapagos(fitness=length, gene=[number_slider_2, number_slider, number_slider_3, number_slider_5, number_slider_4])
