# Grasshopper definition ChaikinsAlgorithmDetail.gh (Grasshopper 1.0.8)

vector_xyz = VectorXYZ(
    XComponent=Slider(-19.2, range=-100..100),
    YComponent=Slider(19.86, range=-100..100),
    ZComponent=Slider(2.35, range=-100..100))  # -> Vector, Length
point = Point([<point referenced from the Rhino model> x9])
c_script = CSharpScript(
    Points=point,
    TangentVector=vector_xyz.Vector,
    Iterations=Slider(6, range=0..10),
    Proportion=Slider(0.25, range=0..1),
    Periodic=Toggle(True))  # -> out, A; inputs Points: list of Point3d, TangentVector: Vector3d, Iterations: Int32, Proportion: Double, Periodic: Boolean
# ---------- c_script: C# ----------
// Grasshopper Script Instance
#region Usings
using System;
using System.Linq;
using System.Collections;
using System.Collections.Generic;
using System.Drawing;

using Rhino;
using Rhino.Geometry;

using Grasshopper;
using Grasshopper.Kernel;
using Grasshopper.Kernel.Data;
using Grasshopper.Kernel.Types;
#endregion

public class Script_Instance : GH_ScriptInstance
{
    #region Notes
    /* 
      Members:
        RhinoDoc RhinoDocument
        GH_Document GrasshopperDocument
        IGH_Component Component
        int Iteration

      Methods (Virtual & overridable):
        Print(string text)
        Print(string format, params object[] args)
        Reflect(object obj)
        Reflect(object obj, string method_name)
    */
    #endregion

    private void RunScript(
		List<Point3d> Points,
		Vector3d TangentVector,
		int Iterations,
		double Proportion,
		bool Periodic,
		ref object A)
    {
        List <Point3d> controlPoints = new List<Point3d>(Points);
        if(Periodic)
        {
            controlPoints.Add(controlPoints[0]);
            controlPoints.Add(controlPoints[1]);
        }
        for(int i=0; i<Iterations; i++)
        {
            controlPoints = SmoothedPolylinePoints(controlPoints, Proportion);
        }
        controlPoints.RemoveAt(controlPoints.Count-1);

        List<Point3d> ctrlPts = ControlPointsFromInterpolationPoints(Points, TangentVector);
        A = ctrlPts;
    }
    private List<Point3d> ControlPointsFromInterpolationPoints(List<Point3d> pts, Vector3d tangent)
        {
            List<Point3d> controlPoints = new List<Point3d>();
            Point3d start = pts[0];
            start.X += tangent.X;
            start.Y += tangent.Y;
            start.Z += tangent.Z;
            controlPoints.Add(start);
            for(int i=0; i<pts.Count; i++)
            {
                Point3d previousPoint = controlPoints[i];
                Point3d interpolationPoint = pts[i];
                Point3d newPoint = PointAlongCurve(previousPoint, interpolationPoint, 2);
                controlPoints.Add(newPoint);
            }
            return controlPoints;
        }
    private List<Point3d> SmoothedPolylinePoints(List<Point3d> pts, double t)
    {
        double t0 = t;
        double t1 = 1-t;
        List<Point3d> newPoints = new List<Point3d>();
        for(int i=1; i<pts.Count; i++)
        {
            Point3d A = pts[i-1];
            Point3d B = pts[i];
            Point3d p0 = PointAlongCurve(A, B, t0);
            Point3d p1 = PointAlongCurve(A, B, t1);
            newPoints.Add(p0);
            newPoints.Add(p1);
        }
        return newPoints;
    }

    private Point3d PointAlongCurve(Point3d a, Point3d b, double t)
    {
        double dx = b.X-a.X;
        double dy = b.Y-a.Y;
        double dz = b.Z-a.Z;

        double nx = t*dx;
        double ny = t*dy;
        double nz = t*dz;

        double cx = a.X+nx;
        double cy = a.Y+ny;
        double cz = a.Z+nz;

        Point3d c = new Point3d(cx, cy, cz);
        return c;
    }
}
# ---------- end c_script ----------
polyline = PolyLine(Vertices=point, Closed=False)
polyline_2 = PolyLine(Vertices=c_script.A, Closed=False)
