# Grasshopper definition CurveRotationTranslation.gh (Grasshopper 1.0.8)

number_slider = Slider(82, range=0..100)

# ---- group: Advanced rotation and translation
value_list = ValueList({"One": 1, "Two": 2, "Three": 2² - 1, "Four": Sqrt(16)}, selected="Two")
point = Point([Point(16, 114, 0), Point(68, 67, 0), Point(111, 131, 0), Point(147, 64, 0), Point(193, 121, 0), Point(203, 53, 0)])
c_script = CSharpScript(
    points=point,
    curveDegree=value_list,
    rotationAngle=Slider(3, range=0..1000),
    translationHeight=Slider(72.45, range=0..100),
    parameterizedPoint=Slider(0.4, range=0..1))  # -> out, a; inputs points: list of Point3d, curveDegree: Int32, rotationAngle: Int32, translationHeight: Double, parameterizedPoint: Double
# ---------- c_script: C# ----------
// Grasshopper Script Instance
#region Usings
using System;
using System.Linq;
using System.Collections;
using System.Collections.Generic;
using System.Drawing;

using Rhino;
using Rhino.Geometry;

using Grasshopper;
using Grasshopper.Kernel;
using Grasshopper.Kernel.Data;
using Grasshopper.Kernel.Types;
#endregion

public class Script_Instance : GH_ScriptInstance
{
    #region Notes
    /* 
      Members:
        RhinoDoc RhinoDocument
        GH_Document GrasshopperDocument
        IGH_Component Component
        int Iteration

      Methods (Virtual & overridable):
        Print(string text)
        Print(string format, params object[] args)
        Reflect(object obj)
        Reflect(object obj, string method_name)
    */
    #endregion

    private void RunScript(
		List<Point3d> points,
		int curveDegree,
		int rotationAngle,
		double translationHeight,
		double parameterizedPoint,
		ref object a)
    {
        Curve baseCurve = Curve.CreateControlPointCurve(points, curveDegree);
        double angleToRadian = RhinoMath.ToRadians(rotationAngle);
        Point3d rotationPoint = baseCurve.PointAtNormalizedLength(parameterizedPoint);
        Vector3d vectorData = new Vector3d(0, 0, translationHeight);
        
        Transform translate = Transform.Translation(vectorData);
        Transform rotate = Transform.Rotation(angleToRadian, rotationPoint);
        Transform combinedTransform = Transform.Multiply(translate, rotate);
        Curve transformedCurve = baseCurve.DuplicateCurve();

        transformedCurve.Transform(combinedTransform);
        a = new List<Curve> (){baseCurve, transformedCurve};
    }
}
# ---------- end c_script ----------

# ----
value_list_2 = ValueList({"One": 1, "Two": 2, "Three": 2² - 1, "Four": Sqrt(16)}, selected="Two")
point_2 = Point([Point(0, 0, 0), Point(19, 7, 0), Point(34, 8, 0), Point(55, -16, 0), Point(90, 10, 0)])

# ---- group: Separate Rotation and Translation
c_script_2 = CSharpScript(points=point_2, degree=value_list_2, rotationDegree=number_slider)  # -> out, a; inputs points: list of Point3d, degree: Int32, rotationDegree: Int32
# ---------- c_script_2: C# ----------
// Grasshopper Script Instance
#region Usings
using System;
using System.Linq;
using System.Collections;
using System.Collections.Generic;
using System.Drawing;

using Rhino;
using Rhino.Geometry;

using Grasshopper;
using Grasshopper.Kernel;
using Grasshopper.Kernel.Data;
using Grasshopper.Kernel.Types;
#endregion

public class Script_Instance : GH_ScriptInstance
{
    #region Notes
    /* 
      Members:
        RhinoDoc RhinoDocument
        GH_Document GrasshopperDocument
        IGH_Component Component
        int Iteration

      Methods (Virtual & overridable):
        Print(string text)
        Print(string format, params object[] args)
        Reflect(object obj)
        Reflect(object obj, string method_name)
    */
    #endregion

    private void RunScript(
		List<Point3d> points,
		int degree,
		int rotationDegree,
		ref object a)
    {
        Curve baseCurve = Curve.CreateControlPointCurve(points, degree);
        Transform translateCurve = Transform.Translation(new Vector3d(0, 20, 0));
        baseCurve.Transform(translateCurve);
        double angle = RhinoMath.ToRadians(rotationDegree);
        Point3d rotationPoint = baseCurve.PointAtNormalizedLength(0.5);
        Transform rotation = Transform.Rotation(angle, rotationPoint);
        Curve duplicateddCurve = baseCurve.DuplicateCurve();
        duplicateddCurve.Transform(rotation);
        a = new List<Curve>() {baseCurve, duplicateddCurve};
    }
}
# ---------- end c_script_2 ----------

# ---- group: Combined Rotation and Translation
c_script_3 = CSharpScript(points=point_2, degree=value_list_2, rotationAngle=number_slider)  # -> out, a; inputs points: list of Point3d, degree: Int32, rotationAngle: Int32
# ---------- c_script_3: C# ----------
// Grasshopper Script Instance
#region Usings
using System;
using System.Linq;
using System.Collections;
using System.Collections.Generic;
using System.Drawing;

using Rhino;
using Rhino.Geometry;

using Grasshopper;
using Grasshopper.Kernel;
using Grasshopper.Kernel.Data;
using Grasshopper.Kernel.Types;
#endregion

public class Script_Instance : GH_ScriptInstance
{
    #region Notes
    /* 
      Members:
        RhinoDoc RhinoDocument
        GH_Document GrasshopperDocument
        IGH_Component Component
        int Iteration

      Methods (Virtual & overridable):
        Print(string text)
        Print(string format, params object[] args)
        Reflect(object obj)
        Reflect(object obj, string method_name)
    */
    #endregion

    private void RunScript(
		List<Point3d> points,
		int degree,
		int rotationAngle,
		ref object a)
    {
        Curve baseCurve = Curve.CreateControlPointCurve(points, degree);
        Vector3d translateVector = new Vector3d(0, 0, 5);
        Transform translate = Transform.Translation(translateVector);
        double rotationAngleAmount = RhinoMath.ToRadians(rotationAngle);
        Point3d rotationPoint = baseCurve.PointAtNormalizedLength(0.5);
        Transform rotation = Transform.Rotation(rotationAngleAmount, rotationPoint);
        Transform combinedTransform = Transform.Multiply(translate, rotation);
        Curve transformedCurve = baseCurve.DuplicateCurve();

        transformedCurve.Transform(combinedTransform);

        a = new List<Curve>() {baseCurve, transformedCurve};
    }
}
# ---------- end c_script_3 ----------

# ---- group: Plotting Curve with Control Points
c_script_4 = CSharpScript(points=point_2, degree=value_list_2)  # -> out, a; inputs points: list of Point3d, degree: Int32
# ---------- c_script_4: C# ----------
// Grasshopper Script Instance
#region Usings
using System;
using System.Linq;
using System.Collections;
using System.Collections.Generic;
using System.Drawing;

using Rhino;
using Rhino.Geometry;

using Grasshopper;
using Grasshopper.Kernel;
using Grasshopper.Kernel.Data;
using Grasshopper.Kernel.Types;
#endregion

public class Script_Instance : GH_ScriptInstance
{
    #region Notes
    /* 
      Members:
        RhinoDoc RhinoDocument
        GH_Document GrasshopperDocument
        IGH_Component Component
        int Iteration

      Methods (Virtual & overridable):
        Print(string text)
        Print(string format, params object[] args)
        Reflect(object obj)
        Reflect(object obj, string method_name)
    */
    #endregion

    private void RunScript(List<Point3d> points, int degree, ref object a)
    {
        Curve baseCurve = Curve.CreateControlPointCurve(points, degree);
        a = baseCurve;
    }
}
# ---------- end c_script_4 ----------
