# Grasshopper definition DetailedCode.gh (Grasshopper 1.0.8)

value_list = ValueList({"One": 1, "Two": 2, "Three": 2² - 1, "Four": Sqrt(16)}, selected="Four")
point = Point([Point(-61, -3, 0), Point(-58, 4, 0), Point(-53, 10, 0), Point(-48, 15, 0), Point(-42, 20, 0), Point(-37, 21, 0), Point(-29, 20, 0), Point(-23, 16, 0), Point(-17, 8, 0), Point(-10, -2, 0)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])
c_script = CSharpScript(
    Points=point,
    Degree=value_list,
    Angle=Slider(10, range=0..100),
    Height=Slider(61, range=0..100),
    ParameterizedValue=Slider(0.8, range=0..1),
    Numbers=Slider(10, range=0..100),
    Segments=Slider(45, range=0..100),
    MeshParameter=Slider(1, range=0..1))  # -> out, A; inputs Points: list of Point3d, Degree: Int32, Angle: Int32, Height: Int32, ParameterizedValue: Double, Numbers: Int32, Segments: Int32, MeshParameter: Double
# ---------- c_script: C# ----------
// Grasshopper Script Instance
#region Usings
using System;
using System.Linq;
using System.Collections;
using System.Collections.Generic;
using System.Drawing;

using Rhino;
using Rhino.Geometry;

using Grasshopper;
using Grasshopper.Kernel;
using Grasshopper.Kernel.Data;
using Grasshopper.Kernel.Types;
#endregion

public class Script_Instance : GH_ScriptInstance
{
    #region Notes
    /* 
      Members:
        RhinoDoc RhinoDocument
        GH_Document GrasshopperDocument
        IGH_Component Component
        int Iteration

      Methods (Virtual & overridable):
        Print(string text)
        Print(string format, params object[] args)
        Reflect(object obj)
        Reflect(object obj, string method_name)
    */
    #endregion

    private void RunScript(
		List<Point3d> Points,
		int Degree,
		int Angle,
		int Height,
		double ParameterizedValue,
		int Numbers,
		int Segments,
		double MeshParameter,
		ref object A)
    {
        List<Curve> combinedCurve = CurveTranslateRotate(Points, Degree, Height, ParameterizedValue, Angle);
        Curve baseCurve = combinedCurve[0];
        Curve transformedCurve = combinedCurve[1];
        (Surface nSurface, Brep bSurface) = CreateSurface(baseCurve, transformedCurve, combinedCurve);
        MeshingParameters mp = new MeshingParameters(MeshParameter);
        List<Mesh> mesh = CreateMesh(nSurface, bSurface, mp);
        (Point3d[][] allPoints, DataTree<Point3d> treePoints) = DivideAndTweenCurve(baseCurve, transformedCurve, Numbers, Segments);
        List<Brep> panels = CreatePanels(allPoints);
        A = panels;
    }
    private Brep MakeSplit(Surface panel)
    {
        double width;
        double height;
        panel.GetSurfaceSize(out height, out width);
        panel.SetDomain(0, new Interval(0, 1));
        panel.SetDomain(1, new Interval(0, 1));
        Plane plane;
        panel.FrameAt(0.5, 0.5, out plane);
        Circle circle = new Circle(plane, height/3);
        Surface ext = Extrusion.CreateExtrusion(circle.ToNurbsCurve(), plane.ZAxis*5);
        ext.Translate(plane.ZAxis*-2);
        Brep panelBrep = panel.ToBrep();
        Brep splitBrep = panelBrep.Split(ext.ToBrep(), 0.001)[0];
        return splitBrep;
    }
    private void DivideAndCutPanels(Surface panels, List<Brep> cutPanels, int swap)
    {
        panels.SetDomain(0, new Interval(0, 1));
        panels.SetDomain(1, new Interval(0, 1));
        if(panels.ToBrep().GetArea()<0.1)
        {
            cutPanels.Add(MakeSplit(panels));
            return;
        }
        Surface[] splits = panels.Split(swap, 0.5);
        cutPanels.Add(MakeSplit(splits[0]));
        DivideAndCutPanels(splits[1], cutPanels, Math.Abs(swap-1));
    }
    private List<Brep> CreatePanels(Point3d[][] allPoints)
    {
        List<Brep> panels = new List<Brep>();
        for(int i=0; i<allPoints.Length; i++)
        {
            for(int j=0; j<allPoints[i].Length; j++)
            {
                try
                {
                    Point3d p1 = allPoints[i][j];
                    Point3d p2 = allPoints[i+1][j];
                    Point3d p3 = allPoints[i+1][j+1];
                    Point3d p4 = allPoints[i][j+1];
                    NurbsSurface panel = NurbsSurface.CreateFromCorners(p1, p2, p3, p4);

                    int swap = 0;
                    DivideAndCutPanels(panel, panels, swap);
                }
                catch(Exception e)
                {
                    Print(e.Message);
                }
            }
        }
        return panels;
    }
    private (Point3d[][], DataTree<Point3d>) DivideAndTweenCurve(Curve curve_1, Curve curve_2, int numbers, int segment)
    {
        Curve[] tweenCurve = Curve.CreateTweenCurves(curve_1, curve_2, numbers);
        int count = 1;
        Point3d[][] allPoints = new Point3d[numbers+2][];
        foreach(Curve tCurve in tweenCurve)
        {
            if(count<numbers+2)
            {
                Point3d[] curvePoints;
                tCurve.DivideByCount(segment, true, out curvePoints);
                allPoints[count]=curvePoints;
                count++;
            }
        }
        curve_1.DivideByCount(segment, true, out allPoints[0]);
        curve_2.DivideByCount(segment, true, out allPoints[numbers+1]);
        DataTree<Point3d> treePoints = new DataTree<Point3d>();
        for(int i=0; i<allPoints.Length; i++)
        {
            GH_Path path = new GH_Path(i);
            treePoints.AddRange(allPoints[i], path);
        }
        return (allPoints, treePoints);
    }

    private (Surface, Brep) CreateSurface(Curve curve_1, Curve curve_2, List<Curve> combinedCurves)
    {
        NurbsSurface nSurface = NurbsSurface.CreateRuledSurface(curve_1, curve_2);
        Brep bSurface = Brep.CreateEdgeSurface(combinedCurves);
        return (nSurface, bSurface);
    }
    private List<Mesh> CreateMesh(Surface nSurface, Brep bSurface, MeshingParameters mp)
    {
        Mesh nMesh = Mesh.CreateFromSurface(nSurface, mp);
        Mesh bMesh = Mesh.CreateFromBrep(bSurface, mp)[0];
        List<Mesh> allMesh = new List<Mesh>(){nMesh, bMesh};
        return allMesh;
    }
    private List<Curve> CurveTranslateRotate(List<Point3d> points, int degree, int height, double parameter, int angle)
    {
        Curve baseCurve = Curve.CreateControlPointCurve(points, degree);
        Vector3d vector = new Vector3d(0, 0, height);
        double rotationAngle = RhinoMath.ToRadians(angle);
        Point3d rotationPoint = baseCurve.PointAtNormalizedLength(parameter);
        Transform translation = Transform.Translation(vector);
        Transform rotation = Transform.Rotation(rotationAngle, rotationPoint);
        Transform combinedTransform = Transform.Multiply(translation, rotation);
        Curve transfromedCurve = baseCurve.DuplicateCurve();
        transfromedCurve.Transform(combinedTransform);
        List<Curve> combinedCurves = new List<Curve>(){baseCurve, transfromedCurve};
        return combinedCurves;
    }
}
# ---------- end c_script ----------
c_script_2 = CSharpScript(Panels=c_script.A, Bake=Button())  # -> out, a; inputs Panels: Brep, Bake: Boolean
# ---------- c_script_2: C# ----------
// Grasshopper Script Instance
#region Usings
using System;
using System.Linq;
using System.Collections;
using System.Collections.Generic;
using System.Drawing;

using Rhino;
using Rhino.Geometry;

using Grasshopper;
using Grasshopper.Kernel;
using Grasshopper.Kernel.Data;
using Grasshopper.Kernel.Types;
#endregion

public class Script_Instance : GH_ScriptInstance
{
    #region Notes
    /* 
      Members:
        RhinoDoc RhinoDocument
        GH_Document GrasshopperDocument
        IGH_Component Component
        int Iteration

      Methods (Virtual & overridable):
        Print(string text)
        Print(string format, params object[] args)
        Reflect(object obj)
        Reflect(object obj, string method_name)
    */
    #endregion

    private void RunScript(Brep Panels, bool Bake, ref object a)
    {
        double Area = Panels.GetArea();
        if(Area>0.5&&Bake)
        {
            Rhino.DocObjects.ObjectAttributes attributes = new Rhino.DocObjects.ObjectAttributes();
            attributes.ObjectColor = System.Drawing.Color.Blue;
            attributes.ColorSource = Rhino.DocObjects.ObjectColorSource.ColorFromObject;
            a = "Bake"+RhinoDocument.Objects.AddBrep(Panels, attributes);
        }
    }
}
# ---------- end c_script_2 ----------
