# Grasshopper definition DifferentSurfaces.gh (Grasshopper 1.0.8)

value_list = ValueList({"One": 1, "Two": 2, "Three": 2² - 1, "Four": Sqrt(16)}, selected="Two")
point = Point([Point(-29, 4, 0), Point(9, 32, 0), Point(56, 33, 0), Point(89, 17, 0), Point(113, -23, 0), Point(155, -15, 0), Point(187, 34, 0), Point(209, 72, 0)])
c_script = CSharpScript(
    points=point,
    curveDegree=value_list,
    rotationAngle=Slider(16, range=-360..360),
    pointAtParameter=Slider(0.7, range=0..1),
    translationHeight=Slider(82.3, range=0..100),
    meshParameter=Slider(1, range=0..1))  # -> out, a; inputs points: list of Point3d, curveDegree: Int32, rotationAngle: Int32, pointAtParameter: Double, translationHeight: Double, meshParameter: Double
# ---------- c_script: C# ----------
// Grasshopper Script Instance
#region Usings
using System;
using System.Linq;
using System.Collections;
using System.Collections.Generic;
using System.Drawing;

using Rhino;
using Rhino.Geometry;

using Grasshopper;
using Grasshopper.Kernel;
using Grasshopper.Kernel.Data;
using Grasshopper.Kernel.Types;
#endregion

public class Script_Instance : GH_ScriptInstance
{
    #region Notes
    /* 
      Members:
        RhinoDoc RhinoDocument
        GH_Document GrasshopperDocument
        IGH_Component Component
        int Iteration

      Methods (Virtual & overridable):
        Print(string text)
        Print(string format, params object[] args)
        Reflect(object obj)
        Reflect(object obj, string method_name)
    */
    #endregion

    private void RunScript(
		List<Point3d> points,
		int curveDegree,
		int rotationAngle,
		double pointAtParameter,
		double translationHeight,
		double meshParameter,
		ref object a)
    {
        Curve baseCurve = CreateCurve(points, curveDegree);
        Curve transformedCurve = MoveAndRotateCurve(baseCurve, translationHeight, pointAtParameter, rotationAngle);
        List<Curve> curves = new List<Curve>(){baseCurve, transformedCurve};

        // Create Nurbs Surface
        NurbsSurface nSurface = NurbsSurface.CreateRuledSurface(baseCurve, transformedCurve);

        // Create Brep Surface (Flexible for extracting properties including area and volumes)
        Brep bSurface = Brep.CreateEdgeSurface(curves);

        //Create Brep surface from NurbsSurface
        Brep nTobSurface = nSurface.ToBrep();

        // Create Mesh from Brep
        MeshingParameters mp = new MeshingParameters(meshParameter);
        Mesh mSurface = Mesh.CreateFromBrep(bSurface, mp)[0];
        a = mSurface;
    }

    private Curve CreateCurve(List<Point3d> points, int degree)
    {
        Curve baseCurve = Curve.CreateControlPointCurve(points, degree);
        return baseCurve;
    }

    private Curve MoveAndRotateCurve(Curve curve, double translationHeight, double pointAtParameter, double rotationAngle)
    {
        Vector3d translationVector = new Vector3d(0, 0, translationHeight);
        Point3d rotationPoint = curve.PointAtNormalizedLength(pointAtParameter);
        double angleOfRotation = RhinoMath.ToRadians(rotationAngle);

        Transform translation = Transform.Translation(translationVector);
        Transform rotation = Transform.Rotation(angleOfRotation, rotationPoint);
        Transform combinedTransformation = Transform.Multiply(translation, rotation);
        
        Curve transformedCurve = curve.DuplicateCurve();
        transformedCurve.Transform(combinedTransformation); 
        return transformedCurve;
    }
}
# ---------- end c_script ----------
panel = Panel(c_script.a)
