# Grasshopper definition ForEachLoop.gh (Grasshopper 1.0.8)

number_slider = Slider(10, range=0..10)
range = Range(Domain=Domain(1, 10), Steps=number_slider)
random = Random(Range=Domain(0, 1), Number=number_slider, Seed=2)  # -> flatten(Random)
construct_point = ConstructPoint(XCoordinate=range, YCoordinate=0, ZCoordinate=0)
sphere = Sphere(Base=construct_point, Radius=random)
c_script = CSharpScript()  # -> out, a
# ---------- c_script: C# ----------
// Grasshopper Script Instance
#region Usings
using System;
using System.Linq;
using System.Collections;
using System.Collections.Generic;
using System.Drawing;

using Rhino;
using Rhino.Geometry;

using Grasshopper;
using Grasshopper.Kernel;
using Grasshopper.Kernel.Data;
using Grasshopper.Kernel.Types;
#endregion

public class Script_Instance : GH_ScriptInstance
{
    #region Notes
    /* 
      Members:
        RhinoDoc RhinoDocument
        GH_Document GrasshopperDocument
        IGH_Component Component
        int Iteration

      Methods (Virtual & overridable):
        Print(string text)
        Print(string format, params object[] args)
        Reflect(object obj)
        Reflect(object obj, string method_name)
    */
    #endregion
    private bool GetHeight(Cylinder cylinder, double height)
    {
        double cHeight = cylinder.TotalHeight;
        return cHeight>=height;
    }

    private void RunScript(object x, object y, ref object a)
    {
        List<Cylinder> cylinders = new List<Cylinder>();
        Random random = new Random();
        
        for(int i=0; i<=10; i++)
        {
            for(int j=0; j<=10; j++)
            {
                Point3d point = new Point3d(i, j, 0);
                Circle circle = new Circle(point, 0.25);
                Cylinder cylinder = new Cylinder(circle, random.Next(1, 10));
                if(GetHeight(cylinder, 3))
                {
                    cylinders.Add(cylinder);
                }
            }
        }
        a = cylinders;
    }
}
# ---------- end c_script ----------
c_script_2 = CSharpScript(spheres=sphere)  # -> out, A; inputs spheres: list of Brep
# ---------- c_script_2: C# ----------
// Grasshopper Script Instance
#region Usings
using System;
using System.Linq;
using System.Collections;
using System.Collections.Generic;
using System.Drawing;

using Rhino;
using Rhino.Geometry;

using Grasshopper;
using Grasshopper.Kernel;
using Grasshopper.Kernel.Data;
using Grasshopper.Kernel.Types;
#endregion

public class Script_Instance : GH_ScriptInstance
{
    #region Notes
    /* 
      Members:
        RhinoDoc RhinoDocument
        GH_Document GrasshopperDocument
        IGH_Component Component
        int Iteration

      Methods (Virtual & overridable):
        Print(string text)
        Print(string format, params object[] args)
        Reflect(object obj)
        Reflect(object obj, string method_name)
    */
    #endregion

    private void RunScript(List<Brep> spheres, ref object A)
    {
        List<double> volumes = new List<double>();
        List<double> areas = new List<double>();
        foreach(Brep sphere in spheres)
        {
            double volume = sphere.GetVolume();
            double area = sphere.GetArea();
            volumes.Add(volume);
            areas.Add(area);
        }
        A = areas;
    }
}
# ---------- end c_script_2 ----------
c_script_3 = CSharpScript()  # -> out, a
# ---------- c_script_3: C# ----------
// Grasshopper Script Instance
#region Usings
using System;
using System.Linq;
using System.Collections;
using System.Collections.Generic;
using System.Drawing;

using Rhino;
using Rhino.Geometry;

using Grasshopper;
using Grasshopper.Kernel;
using Grasshopper.Kernel.Data;
using Grasshopper.Kernel.Types;
#endregion

public class Script_Instance : GH_ScriptInstance
{
    #region Notes
    /* 
      Members:
        RhinoDoc RhinoDocument
        GH_Document GrasshopperDocument
        IGH_Component Component
        int Iteration

      Methods (Virtual & overridable):
        Print(string text)
        Print(string format, params object[] args)
        Reflect(object obj)
        Reflect(object obj, string method_name)
    */
    #endregion
    private int IntChange(int number)
    {
        number = 213;
        return number;
    }

    private List<int> ListChange(List<int> numbers)
    {
        numbers.Add(34);
        return numbers;
    }

    private void RunScript(object x, object y, ref object a)
    {
        int i = 123;
        int j = IntChange(i);
        List<int> myList_1 = new List<int>{23, 1, 9};
        List<int> myList_2 = ListChange(myList_1);
        a = myList_1;
    }
}
# ---------- end c_script_3 ----------
panel = Panel(c_script_3.a)
panel_2 = Panel(c_script.a)
panel_3 = Panel(c_script_2.A)
