# Grasshopper definition GameOfLife.gh (Grasshopper 1.0.8)
# plug-ins: Bifocals

number_slider = Slider(40, range=0..100)
number_slider_2 = Slider(50, range=0..100)
square = Square(Plane=PlaneXY(0, 0, 0), Size=1, ExtentX=number_slider_2, ExtentY=number_slider)  # -> Cells, Points
addition = Addition(A=number_slider_2, B="1")
addition_2 = Addition(A=number_slider, B="1")
rectangle = Rectangle(square.Cells)
point = Point(square.Points)
curve = Curve(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)
area = Area(Geometry=rectangle)  # -> Area, Centroid
point_in_curve = PointInCurve(Point=area.Centroid, Curve=curve)  # -> Relationship, Point
equality = Equality(FirstNumber=point_in_curve.Relationship, SecondNumber="2")  # -> Equality, Inequality
flatten_tree = FlattenTree(Tree=rectangle, Path="{0}")
trigger = Trigger(Interval=2000, TimerInterval=2000, Target=c_script)
surface = Surface(flatten_tree)
flatten_tree_2 = FlattenTree(Tree=equality.Equality, Path="{0}")
cull_pattern = CullPattern(List=rectangle, CullPattern=equality.Equality)
panel = Panel("""2
3""")
c_script = CSharpScript(
    Cells=flatten_tree_2,
    Rows=number_slider,
    Columns=number_slider_2,
    BirthRule="3",
    SurvivalRule=panel,
    Run=Toggle(True),
    Reset=Toggle(True))  # -> out, PreviousState, NewIteration, A, B; inputs Cells: list of Boolean, Rows: Int32, Columns: Int32, BirthRule: list of Int32, SurvivalRule: list of Int32, Run: Boolean, Reset: Boolean
# ---------- c_script: C# ----------
// Grasshopper Script Instance
#region Usings
using System;
using System.Linq;
using System.Collections;
using System.Collections.Generic;
using System.Drawing;

using Rhino;
using Rhino.Geometry;

using Grasshopper;
using Grasshopper.Kernel;
using Grasshopper.Kernel.Data;
using Grasshopper.Kernel.Types;
#endregion

public class Script_Instance : GH_ScriptInstance
{
    #region Notes
    /* 
      Members:
        RhinoDoc RhinoDocument
        GH_Document GrasshopperDocument
        IGH_Component Component
        int Iteration

      Methods (Virtual & overridable):
        Print(string text)
        Print(string format, params object[] args)
        Reflect(object obj)
        Reflect(object obj, string method_name)
    */
    #endregion

    private void RunScript(
		List<bool> Cells,
		int Rows,
		int Columns,
		List<int> BirthRule,
		List<int> SurvivalRule,
		bool Run,
		bool Reset,
		ref object PreviousState,
		ref object NewIteration,
		ref object A,
		ref object B)
    {
        if(!Run) return;
        if (Cells.Count!=Columns*Rows)
        {
            Component.AddRuntimeMessage(GH_RuntimeMessageLevel.Error, "Something weird with dimensions of grid");
            return;
        }
        if(Reset==true)
        {
            // Turn list into 2D array
            previousCells = new bool[Columns, Rows];
            int count = 0;
            for(int j=0; j<Columns; j++)
            {
                for(int i=0; i<Rows; i++)
                {
                    previousCells[j, i] = Cells[count];
                    count++;
                }
            }
        }

        // Iterate over the number of iterations
        int[,] nCount = new int[Columns, Rows];
        bool[,] newCells = new bool[Columns, Rows];
        for(int j=0; j<Columns; j++)
        {
            for(int i=0; i<Rows; i++)
            {
                int aliveNeighbors = 0;

                // Define two variables for finding all possible 8 neighbors
                int ni, nj;
                // Top-left neighbor
                ni = i+1;
                nj = j-1;
                if(ni>Rows-1)
                {
                    ni = 0;
                }
                else if(ni<0)
                {
                    ni = Rows-1;
                }
                if(nj>Columns-1) nj=0;
                else if(nj<0) nj=Columns-1;
                // Adding alive neighbor to the list
                if(previousCells[nj, ni] == true) aliveNeighbors++;

                // Top neighbor
                ni = i+1;
                nj = j;
                if(ni>Rows-1)
                {
                    ni = 0;
                }
                else if(ni<0)
                {
                    ni = Rows-1;
                }
                if(nj>Columns-1) nj=0;
                else if(nj<0) nj=Columns-1;
                // Adding alive neighbor to the list
                if(previousCells[nj, ni] == true) aliveNeighbors++;

                //Top-Right neighbor
                ni = i+1;
                nj = j+1;
                if(ni>Rows-1)
                {
                    ni = 0;
                }
                else if(ni<0)
                {
                    ni = Rows-1;
                }
                if(nj>Columns-1) nj=0;
                else if(nj<0) nj=Columns-1;
                // Adding alive neighbor to the list
                if(previousCells[nj, ni] == true) aliveNeighbors++;

                // Right neighbor
                ni = i;
                nj = j+1;
                if(ni>Rows-1)
                {
                    ni = 0;
                }
                else if(ni<0)
                {
                    ni = Rows-1;
                }
                if(nj>Columns-1) nj=0;
                else if(nj<0) nj=Columns-1;
                // Adding alive neighbor to the list
                if(previousCells[nj, ni] == true) aliveNeighbors++;

                // Bottom-Right neighbor
                ni = i-1;
                nj = j+1;
                if(ni>Rows-1)
                {
                    ni = 0;
                }
                else if(ni<0)
                {
                    ni = Rows-1;
                }
                if(nj>Columns-1) nj=0;
                else if(nj<0) nj=Columns-1;
                // Adding alive neighbor to the list
                if(previousCells[nj, ni] == true) aliveNeighbors++;

                // Bottom neighbor
                ni = i-1;
                nj = j;
                if(ni>Rows-1)
                {
                    ni = 0;
                }
                else if(ni<0)
                {
                    ni = Rows-1;
                }
                if(nj>Columns-1) nj=0;
                else if(nj<0) nj=Columns-1;
                // Adding alive neighbor to the list
                if(previousCells[nj, ni] == true) aliveNeighbors++;

                // Bottom-Left neighbor
                ni = i-1;
                nj = j-1;
                if(ni>Rows-1)
                {
                    ni = 0;
                }
                else if(ni<0)
                {
                    ni = Rows-1;
                }
                if(nj>Columns-1) nj=0;
                else if(nj<0) nj=Columns-1;
                // Adding alive neighbor to the list
                if(previousCells[nj, ni] == true) aliveNeighbors++;

                // Left neighbor
                ni = i;
                nj = j-1;
                if(ni>Rows-1)
                {
                    ni = 0;
                }
                else if(ni<0)
                {
                    ni = Rows-1;
                }
                if(nj>Columns-1) nj=0;
                else if(nj<0) nj=Columns-1;
                // Adding alive neighbor to the list
                if(previousCells[nj, ni] == true) aliveNeighbors++;
                nCount[j, i] = aliveNeighbors;
                Print("Alive neighbors: "+ aliveNeighbors);
                
                // Compute new state of cells
                bool prevState = previousCells[j, i];
                bool newState = false;

                    // If the cell was dead
                    if(prevState==false)
                    {
                        foreach(int b in BirthRule)
                        {
                           if(b==aliveNeighbors)
                            {
                                newState=true;
                                break;
                            }
                        }
                    }
                    // If the cell is alive
                    else
                    {
                        foreach(int s in SurvivalRule)
                        {
                            if(s==aliveNeighbors)
                            {
                                newState=true;
                                break;
                            }
                        }
                    }
                    // Store new state in new array
                    newCells[j, i] = newState;
                }
            }
        PreviousState = previousCells;
        NewIteration = newCells;
        A = nCount;
        // Store new cells for next iteration
        previousCells = newCells;
    }
    bool[,] previousCells;
}
# ---------- end c_script ----------
cull_pattern_2 = CullPattern(List=surface, CullPattern=c_script.NewIteration)
