# Grasshopper definition NurbsMeshBrepSurfaces.gh (Grasshopper 1.0.8)

value_list = ValueList({"One": 1, "Two": 2, "Three": 2² - 1, "Four": Sqrt(16)}, selected="Two")
point = Point([Point(-29, 4, 0), Point(9, 32, 0), Point(56, 33, 0), Point(89, 17, 0), Point(113, -23, 0), Point(155, -15, 0), Point(187, 34, 0), Point(209, 72, 0)])
c_script = CSharpScript(
    Points=point,
    Degree=value_list,
    Angle=Slider(16, range=-360..360),
    ParameterizedPoint=Slider(0.5, range=0..1),
    Height=Slider(67, range=0..100))  # -> out, a; inputs Points: list of Point3d, Degree: Int32, Angle: Int32, ParameterizedPoint: Double, Height: Int32
# ---------- c_script: C# ----------
// Grasshopper Script Instance
#region Usings
using System;
using System.Linq;
using System.Collections;
using System.Collections.Generic;
using System.Drawing;

using Rhino;
using Rhino.Geometry;

using Grasshopper;
using Grasshopper.Kernel;
using Grasshopper.Kernel.Data;
using Grasshopper.Kernel.Types;
#endregion

public class Script_Instance : GH_ScriptInstance
{
    #region Notes
    /* 
      Members:
        RhinoDoc RhinoDocument
        GH_Document GrasshopperDocument
        IGH_Component Component
        int Iteration

      Methods (Virtual & overridable):
        Print(string text)
        Print(string format, params object[] args)
        Reflect(object obj)
        Reflect(object obj, string method_name)
    */
    #endregion

    private void RunScript(
		List<Point3d> Points,
		int Degree,
		int Angle,
		double ParameterizedPoint,
		int Height,
		ref object a)
    {
        Curve baseCurve = CreateCurve(Points, Degree);
        Curve transformedCurve = MoveAndRotate(baseCurve, Angle, ParameterizedPoint, Height);
        List<Curve> combinedCurves = new List<Curve> (){baseCurve, transformedCurve};

        NurbsSurface nSurface = NurbsSurface.CreateRuledSurface(baseCurve, transformedCurve);
        Brep bSurface = nSurface.ToBrep();
        MeshingParameters mp = new MeshingParameters(0.7);
        //Create mesh from Brep Surface
        Mesh mSurface = Mesh.CreateFromBrep(bSurface, mp)[0];
        //Create mesh from nurbs surface
        Mesh m_Surface = Mesh.CreateFromSurface(nSurface, mp);
        a = m_Surface;
    }

    private Curve CreateCurve(List<Point3d> points, int degree)
    {
        Curve curve = Curve.CreateControlPointCurve(points, degree);
        return curve;
    }

    private Curve MoveAndRotate(Curve curve, int angle, double pointParameter, double height)
    {
        Vector3d vector = new Vector3d(0, 0, height);
        Point3d rotationPoint = curve.PointAtNormalizedLength(pointParameter);
        double radianAngle = RhinoMath.ToRadians(angle);
        Transform translation = Transform.Translation(vector);
        Transform rotation = Transform.Rotation(radianAngle, rotationPoint);
        Transform combinedTransform = Transform.Multiply(translation, rotation);
        Curve transformedCurve = curve.DuplicateCurve();
        transformedCurve.Transform(combinedTransform);
        return transformedCurve;
    }
}
# ---------- end c_script ----------
