# Grasshopper definition TweenCurvesDataTreeDivideCurve.gh (Grasshopper 1.0.8)

value_list = ValueList({"One": 1, "Two": 2, "Three": 2² - 1, "Four": Sqrt(16)}, selected="Two")
point = Point([Point(-125, -23, 0), Point(-103, 40, 0), Point(-72, 77, 0), Point(-17, 71, 0), Point(18, 17, 0), Point(58, -40, 0), Point(114, -43, 0), Point(168, -14, 0), Point(209, 45, 0), Point(256, 95, 0), Point(317, 139, 0)])
c_script = CSharpScript(
    Points=point,
    Degree=value_list,
    Angle=Slider(360, range=0..1000),
    ParameterPoint=Slider(0.5, range=0..1),
    Height=Slider(91, range=0..100),
    Tween=Slider(8, range=1..20),
    Segments=Slider(23, range=1..100),
    MeshParameter=Slider(1, range=0..1))  # -> out, A; inputs Points: list of Point3d, Degree: Int32, Angle: Int32, ParameterPoint: Double, Height: Double, Tween: Int32, Segments: Int32, MeshParameter: Double
# ---------- c_script: C# ----------
// Grasshopper Script Instance
#region Usings
using System;
using System.Linq;
using System.Collections;
using System.Collections.Generic;
using System.Drawing;

using Rhino;
using Rhino.Geometry;

using Grasshopper;
using Grasshopper.Kernel;
using Grasshopper.Kernel.Data;
using Grasshopper.Kernel.Types;
#endregion

public class Script_Instance : GH_ScriptInstance
{
    #region Notes
    /* 
      Members:
        RhinoDoc RhinoDocument
        GH_Document GrasshopperDocument
        IGH_Component Component
        int Iteration

      Methods (Virtual & overridable):
        Print(string text)
        Print(string format, params object[] args)
        Reflect(object obj)
        Reflect(object obj, string method_name)
    */
    #endregion

    private void RunScript(
		List<Point3d> Points,
		int Degree,
		int Angle,
		double ParameterPoint,
		double Height,
		int Tween,
		int Segments,
		double MeshParameter,
		ref object A)
    {
        Curve baseCurve = CreateCurve(Points, Degree);
        Curve transformedCurve = RotateAndTranslate(baseCurve, Angle, ParameterPoint, Height);
        List<Curve> combinedCurves = new List<Curve>(){baseCurve, transformedCurve};
        NurbsSurface nSurface = CreateNurbsSurface(baseCurve, transformedCurve);
        Brep bSurface = CreateBrepSurface(combinedCurves);
        // Mesh needs MeshingParameter as object, so we have to create object first then pass it
        MeshingParameters mp = new MeshingParameters(MeshParameter);
        // As meshing are done with two surfaces, so we have to use indexing for geting surface
        Mesh mesh = MeshFromBrepAndNurbs(bSurface, nSurface, mp)[1];
        Point3d[][] allPoints = CreateTweenAndDivideCurves(baseCurve, transformedCurve, Tween, Segments);
        
        // Define an empty DataTree that stores curve points
        DataTree<Point3d> pointTree = new DataTree<Point3d>();
        for(int i=0; i<allPoints.Length; i++)
        {
            // Define the path and each time loop runs, it creates a branch
            GH_Path path = new GH_Path(i);
            // Add data to the defined pointTree using AddRange
            pointTree.AddRange(allPoints[i], path);
        }
        A = pointTree;
    }
    private Point3d[][] CreateTweenAndDivideCurves(Curve curve_1, Curve curve_2, int numbers, int segments)
    {
        Curve[] tweenCurves = Curve.CreateTweenCurves(curve_1, curve_2, numbers, 0.001);
        Point3d[][] allPoints = new Point3d[numbers+2][];
        int count = 1;
        foreach(Curve tCurve in tweenCurves)
        {
            if(count<numbers+2)
            {
                Point3d[] curvePoints;
                tCurve.DivideByCount(segments, true, out curvePoints);
                allPoints[count] = curvePoints;
                count++;
            }
        }
        curve_1.DivideByCount(segments, true, out allPoints[0]);
        curve_2.DivideByCount(segments, true, out allPoints[numbers+1]);
        return allPoints;
    }

    private NurbsSurface CreateNurbsSurface(Curve curve_1, Curve curve_2)
    {
        NurbsSurface nSurface = NurbsSurface.CreateRuledSurface(curve_1, curve_2);
        return nSurface;
    }

    private Brep CreateBrepSurface(List<Curve> combinedCurves)
    {
        Brep bSurface = Brep.CreateEdgeSurface(combinedCurves);
        return bSurface;
    }

    private List<Mesh> MeshFromBrepAndNurbs(Brep bSurface, NurbsSurface nSurface, MeshingParameters meshParameters)
    {
        Mesh nurbMesh = Mesh.CreateFromSurface(nSurface, meshParameters);
        Mesh brepMesh = Mesh.CreateFromBrep(bSurface, meshParameters)[0];
        return new List<Mesh>() {brepMesh, nurbMesh};
    }

    private Curve CreateCurve(List<Point3d> points, int degree)
    {
        Curve curve = Curve.CreateControlPointCurve(points, degree);
        return curve;
    }
    private Curve RotateAndTranslate(Curve curve, int angle, double parameterPoint, double height)
    {
        Vector3d vector = new Vector3d(0, 0, height);
        Point3d rotatioPoint = curve.PointAtNormalizedLength(parameterPoint);
        double rotationAngle = RhinoMath.ToRadians(angle);
        Transform translation = Transform.Translation(vector);
        Transform rotation = Transform.Rotation(rotationAngle, rotatioPoint);
        Transform combinedTransform = Transform.Multiply(translation, rotation);
        Curve transformedCurve = curve.DuplicateCurve();
        transformedCurve.Transform(combinedTransform);
        return transformedCurve;
    }
}
# ---------- end c_script ----------
panel = Panel(c_script.A)
