# Grasshopper definition TweenDivideDataTreePanels.gh (Grasshopper 1.0.8)

value_list = ValueList({"One": 1, "Two": 2, "Three": 2² - 1, "Four": Sqrt(16)}, selected="Three")
point = Point([Point(-77, -1, 0), Point(-66, 17, 0), Point(-54, 37, 0), Point(-45, 50, 0), Point(-37, 59, 0), Point(-23, 62, 0), Point(-2, 54, 0), Point(9, 42, 0), Point(24, 26, 0), Point(41, 11, 0), Point(64, 2, 0), Point(77, 8, 0), Point(87, 22, 0), Point(104, 46, 0), Point(122, 70, 0), Point(140, 70, 0), Point(158, 58, 0), Point(183, 37, 0), Point(197, 24, 0), Point(222, 8, 0), Point(236, 7, 0), Point(250, 16, 0), Point(263, 36, 0), Point(275, 65, 0), Point(285, 86, 0)])
c_script = CSharpScript(
    Points=point,
    Degree=value_list,
    Angle=Slider(730, range=0..1000),
    Height=Slider(186, range=0..1000),
    Parameter=Slider(0.4, range=0..1),
    Numbers=Slider(10, range=0..100),
    Segments=Slider(18, range=0..100),
    MeshParameter=Slider(1, range=0..1))  # -> out, A; inputs Points: list of Point3d, Degree: Int32, Angle: Int32, Height: Int32, Parameter: Double, Numbers: Int32, Segments: Int32, MeshParameter: Double
# ---------- c_script: C# ----------
// Grasshopper Script Instance
#region Usings
using System;
using System.Linq;
using System.Collections;
using System.Collections.Generic;
using System.Drawing;

using Rhino;
using Rhino.Geometry;

using Grasshopper;
using Grasshopper.Kernel;
using Grasshopper.Kernel.Data;
using Grasshopper.Kernel.Types;
#endregion

public class Script_Instance : GH_ScriptInstance
{
    #region Notes
    /* 
      Members:
        RhinoDoc RhinoDocument
        GH_Document GrasshopperDocument
        IGH_Component Component
        int Iteration

      Methods (Virtual & overridable):
        Print(string text)
        Print(string format, params object[] args)
        Reflect(object obj)
        Reflect(object obj, string method_name)
    */
    #endregion

    private void RunScript(
		List<Point3d> Points,
		int Degree,
		int Angle,
		int Height,
		double Parameter,
		int Numbers,
		int Segments,
		double MeshParameter,
		ref object A)
    {
        // Create first curve
        Curve baseCurve = CreateCurve(Points, Degree);
        // Call the transformed curve
        Curve transformedCurve = TranslateAndRotate(baseCurve, Angle, Height, MeshParameter);
        // Create combined set of curves
        List<Curve> combinedCurves = new List<Curve>(){baseCurve, transformedCurve};
        NurbsSurface nSurface = CreateNurbsSurface(baseCurve, transformedCurve);
        Brep bSurface = CreateBrepSurface(combinedCurves);
        // Create mesh using MeshingParameter for controlling mesh density
        MeshingParameters mp = new MeshingParameters(MeshParameter);
        List<Mesh> nbMesh = CreateMesh(bSurface, nSurface, mp);
        // Get all the points in jaggered list
        Point3d[][] allPoints = DivideAndTween(baseCurve, transformedCurve, Numbers, Segments);
        // Create a DataTree of points
        DataTree<Point3d> pointTree = new DataTree<Point3d>();
        // Create loop for extracting all points using DataTree
        for(int i=0; i<allPoints.Length; i++)
        {
            GH_Path path = new GH_Path(i);
            pointTree.AddRange(allPoints[i], path);
        }
        // Call the panel generation function
        List<NurbsSurface> panels = CreatePanels(allPoints);
    
        A = panels;
    }
    // Create a function for creating panels in the NurbsSurface format
    private List<NurbsSurface> CreatePanels(Point3d[][] allPoints)
    {
        // Define a empty list of NurbsSurface that can store the panels
        List<NurbsSurface> panels = new List<NurbsSurface>();
        for(int i=0; i<allPoints.Length; i++)
        {
            for(int j=0; j<allPoints[0].Length; j++)
            {
                try
                {
                    // Get all the points in mesh grid
                    Point3d p1 = allPoints[i][j];
                    Point3d p2 = allPoints[i][j+1];
                    Point3d p3 = allPoints[i+1][j+1];
                    Point3d p4 = allPoints[i+1][j];
                    NurbsSurface panel = NurbsSurface.CreateFromCorners(p1, p2, p3, p4);
                    panels.Add(panel);
                }
                catch(Exception e)
                {
                    Print(e.Message);
                }
            }
        }
        return panels;
    }
    // Create tween curves and divide in segments
    private Point3d[][] DivideAndTween(Curve curve_1, Curve curve_2, int tweenNumber, int segments)
    {
        Point3d[][] allPoints = new Point3d[tweenNumber+2][];
        Curve[] tweenCurves = Curve.CreateTweenCurves(curve_1, curve_2, tweenNumber);
        int count = 1;
        foreach(Curve tCurve in tweenCurves)
        {
            if(count<tweenNumber+2)
            {
                Point3d[] curvePoints;
                tCurve.DivideByCount(segments, true, out curvePoints);
                allPoints[count] = curvePoints;
                count++;
            }
        }
        curve_1.DivideByCount(segments, true, out allPoints[0]);
        curve_2.DivideByCount(segments, true, out allPoints[tweenNumber+1]);
        return allPoints;
    }
    private NurbsSurface CreateNurbsSurface(Curve curve_1, Curve curve_2)
    {
        NurbsSurface nSurface = NurbsSurface.CreateRuledSurface(curve_1, curve_2);
        return nSurface;
    }
    private Brep CreateBrepSurface(List<Curve> combinedCurves)
    {
        Brep bSurface = Brep.CreateEdgeSurface(combinedCurves);
        return bSurface;
    }
    private List<Mesh> CreateMesh(Brep bSurface, NurbsSurface nSurface, MeshingParameters mp)
    {
        Mesh nMesh = Mesh.CreateFromSurface(nSurface, mp);
        Mesh bMesh = Mesh.CreateFromBrep(bSurface, mp)[0];
        return new List<Mesh>(){nMesh, bMesh};
    }
    private Curve CreateCurve(List<Point3d> points, int degree)
    {
        Curve curve = Curve.CreateControlPointCurve(points, degree);
        return curve;
    }
    private Curve TranslateAndRotate(Curve curve, int angle, int height, double parameterPoint)
    {
        Vector3d vector = new Vector3d(0, 0, height);
        double rotationAngle = RhinoMath.ToRadians(angle);
        Point3d rotationPoint = curve.PointAtNormalizedLength(parameterPoint);
        Transform translation = Transform.Translation(vector);
        Transform rotation = Transform.Rotation(rotationAngle, rotationPoint);
        Transform combinedTransform = Transform.Multiply(translation, rotation);
        Curve transformedCurve = curve.DuplicateCurve();
        transformedCurve.Transform(combinedTransform);
        return transformedCurve;
    }
}
# ---------- end c_script ----------
